# Grasshopper definition visiting_geometric_architecture_1.gh (Grasshopper 1.0.7)

srf = Surface(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)
int = Integer(Slider(5, range=2..10))
num = Number(Slider(2500, range=0..5000))
int_2 = Integer(Slider(49, range=0..100))
int_3 = Integer(Slider(60, range=10..100))
num_2 = Number(Slider(50, range=10..100))
srf_2 = Surface(srf)
int_4 = Integer(int)
num_3 = Number(num)
int_5 = Integer(int_2)
srf_3 = Surface(srf)
int_6 = Integer(int_3)
sdivide = DivideSurface(Surface=srf_3, UCount=int_6, VCount="1")  # -> Points, Normals, Parameters
sdivide_2 = DivideSurface(Surface=srf_2, UCount=int_4, VCount=int_4)  # -> flatten(Points), Normals, Parameters
pline = PolyLine(Vertices=sdivide.Points, Closed=False)  # -> flatten(Polyline)
dom = ConstructDomain(DomainStart="0", DomainEnd=num_3)
lng = ListLength(List=sdivide_2.Points)
line = Line(pline)
random = Random(Range=dom, Number=lng, Seed=int_5)
Z = UnitZ(Factor=random)
expression = Expression(x=int_4, Expression="x + 1")
move = Move(Geometry=sdivide_2.Points, Motion=Z)  # -> Geometry, Transform
srfgrid = SurfaceFromPoints(Points=move.Geometry, UCount=expression, Interpolate=False)
srf_4 = Surface(srfgrid)
srf_5 = Surface(srf_4)
line_2 = Line(line)
num_4 = Number(num_2)
project = Project(Curve=line_2, Brep=srf_5, Direction=Vector(0, 0, 1))  # -> flatten(Curve)
pipe = Pipe(Curve=project, Radius=num_4, Caps=0)  # -> flatten(Pipe)
srf_6 = Surface(pipe)
